# Grasshopper definition EntryShellNV1.gh (Grasshopper 1.0.7)
# plug-ins: Pufferfish, LunchBox, Weaverbird, Kangaroo2 Components

# ---- group: RH_IN:hight
number_slider = Slider(22, range=0..100)

# ---- group: RH_IN:radius
fillet_radius = Slider(6, range=0..100)

# ---- group: RH_IN:count
segments = Slider(7, range=0..100)

# ---- group: RH_IN:radius2
number_slider_2 = Slider(6, range=0..100)

# ---- group: RH_IN:size
radius = Slider(17, range=0..100)

# ---- group: RH_IN:fillet
number_slider_3 = Slider(5, range=0..100)

# ----
construct_point = ConstructPoint(XCoordinate=0, YCoordinate=0, ZCoordinate=number_slider)
polygon = Polygon(Plane=construct_point, Radius=number_slider_2, Segments=segments, FilletRadius=number_slider_3)  # -> Polygon, Length
polygon_2 = Polygon(Plane=PlaneXY(0, 0, 0), Radius=radius, Segments=segments, FilletRadius=fillet_radius)  # -> Polygon, Length
division = Division(A="180", B=segments)
rotate = Rotate(Geometry=polygon.Polygon, Angle=degrees(division), Plane=PlaneXY(0, 0, 0))  # -> Geometry, Transform
explode = Explode(Curve=polygon_2.Polygon, Recursive=True)  # -> Segments, Vertices
dispatch = Dispatch(List=explode.Segments, DispatchPattern=[True, False])  # -> ListA, ListB
explode_2 = Explode(Curve=rotate.Geometry, Recursive=True)  # -> Segments, Vertices
curve = Curve(dispatch.ListB)
curve_2 = Curve(dispatch.ListA)
dispatch_2 = Dispatch(List=explode_2.Segments, DispatchPattern=[True, False])  # -> ListA, ListB
end_points = EndPoints(Curve=curve)  # -> Start, End
curve_middle = CurveMiddle(Curve=curve)
unit_z = UnitZ(Factor=Slider(8, range=0..100))
curve_3 = Curve(dispatch_2.ListA)
curve_4 = Curve(dispatch_2.ListB)
end_points_2 = EndPoints(Curve=curve_4)  # -> Start, End
move = Move(Geometry=curve_middle, Motion=unit_z)  # -> Geometry, Transform
curve_middle_2 = CurveMiddle(Curve=curve_4)
unit_z_2 = UnitZ(Factor=Slider(2, range=0..100))
arc_3pt = Arc3Pt(PointA=end_points.Start, PointB=move.Geometry, PointC=end_points.End)  # -> Arc, Plane, Radius
line = Line(StartPoint=end_points.Start, EndPoint=end_points.End)
move_2 = Move(Geometry=curve_middle_2, Motion=unit_z_2)  # -> Geometry, Transform
arc_3pt_2 = Arc3Pt(PointA=end_points_2.Start, PointB=move_2.Geometry, PointC=end_points_2.End)  # -> Arc, Plane, Radius
rotate_axis = RotateAxis(Geometry=arc_3pt.Arc, Angle=degrees(Slider(0, range=0..100)), Axis=line)  # -> Geometry, Transform
line_2 = Line(StartPoint=end_points_2.Start, EndPoint=end_points_2.End)
number_slider_4 = Slider(1, range=0..1)
shift_list = ShiftList(List=rotate_axis.Geometry, Shift=Slider(1, range=0..1), Wrap=True)
rotate_axis_2 = RotateAxis(Geometry=arc_3pt_2.Arc, Angle=degrees(Slider(100, range=0..100)), Axis=line_2)  # -> Geometry, Transform
number_slider_5 = Slider(1, range=0..1)
blend_curve = BlendCurve(CurveA=rotate_axis.Geometry, CurveB=shift_list, BulgeA=number_slider_4, BulgeB=number_slider_4, Continuity=2)
shift_list_2 = ShiftList(List=rotate_axis_2.Geometry, Shift=Slider(1, range=0..1), Wrap=True)
number_slider_6 = Slider(30, range=0..100)
blend_curve_2 = BlendCurve(CurveA=rotate_axis_2.Geometry, CurveB=shift_list_2, BulgeA=number_slider_5, BulgeB=number_slider_5, Continuity=2)
project = Project(Geometry=blend_curve, Plane=PlaneXY(0, 0, 0))  # -> Geometry, Transform
unit_z_3 = UnitZ(Factor=number_slider_6)
line_sdl = LineSDL(Start="0,0,0", Direction="1,0,0", Length=number_slider_6)
join_curves = JoinCurves(Curves=flatten([project.Geometry, rotate_axis.Geometry]), Preserve=False)
extrude = Extrude(Base=line_sdl, Direction=unit_z_3)
join_curves_2 = JoinCurves(Curves=flatten([rotate_axis_2.Geometry, blend_curve_2]), Preserve=False)
brep_curve = BrepCurve(Brep=extrude, Curve=join_curves)  # -> Curves, Points
brep_curve_2 = BrepCurve(Brep=extrude, Curve=join_curves_2)  # -> Curves, Points
circle = Circle(Plane=PlaneXY(0, 0, 0), Radius=Slider(10, range=0..100))
unit_z_4 = UnitZ(Factor=Slider(20, range=0..100))
extrude_2 = Extrude(Base=circle, Direction=unit_z_4)
quad_panels = QuadPanels(Surface=extrude_2, UDivisions=Slider(10, range=0..100), VDivisions=Slider(50, range=0..100))
simple_mesh = SimpleMesh(Brep=quad_panels)
weaverbird_s_join_meshes_and_weld = WeaverbirdsJoinMeshesAndWeld(Mesh=simple_mesh, Weld=False)
weaverbird_s_catmull_clark_subdivision = WeaverbirdsCatmullClarkSubdivision(MeshCurves=weaverbird_s_join_meshes_and_weld, Level=1, SmoothNakedEdges=1)
nakedvertices = NakedVertices(Mesh=weaverbird_s_catmull_clark_subdivision)  # -> ClothedIndex, NakedIndex, ClothedPts, NakedPts
point = Point(nakedvertices.NakedPts)
list_length = ListLength(List=point)
deconstruct = Deconstruct(Point=point)  # -> XComponent, YComponent, ZComponent
sort_list = SortList(Keys=deconstruct.ZComponent, ValuesValuesA=point)  # -> Keys, ValuesValuesA
split_list = SplitList(List=sort_list.ValuesValuesA, Index=expr("x/2", list_length))  # -> ListA, ListB
circle_2 = Circle(Plane=PlaneXY(0, 0, 0), Radius=1)
circle_3 = Circle(Plane=PlaneXY(0, 0, 0), Radius=1)
align_curve_seams = AlignCurveSeams(Curves=join_curves, Guide=brep_curve.Points, Snap=False, Iterative=True)  # -> Aligned, Points, ResultBoolean
align_curve_seams_2 = AlignCurveSeams(Curves=join_curves_2, Guide=brep_curve_2.Points, Snap=False, Iterative=True)  # -> Aligned, Points, ResultBoolean
point_2 = Point(split_list.ListA)
point_3 = Point(split_list.ListB)
divide_curve = DivideCurve(Curve=align_curve_seams.Aligned, Count=expr("x/2", list_length), Kinks=False)  # -> Points, Tangents, Parameters
divide_curve_2 = DivideCurve(Curve=align_curve_seams_2.Aligned, Count=expr("x/2", list_length), Kinks=False)  # -> Points, Tangents, Parameters
sort_along_curve = SortAlongCurve(Points=point_2, Curve=circle_2)  # -> Points, Indices
sort_along_curve_2 = SortAlongCurve(Points=point_3, Curve=circle_3)  # -> Points, Indices
anchor = Anchor(Point=sort_along_curve.Points, Target=divide_curve.Points, Strength=10000)
anchor_2 = Anchor(Point=sort_along_curve_2.Points, Target=divide_curve_2.Points, Strength=10000)
vertexloads = VertexLoads(Mesh=weaverbird_s_catmull_clark_subdivision, Strength=Slider(0.01, range=0..0.1))
show = Show(G=weaverbird_s_catmull_clark_subdivision)
edgelengths = EdgeLengths(Mesh=weaverbird_s_catmull_clark_subdivision, LengthFactor=Slider(0.12, range=0..1), Strength=1)
solver = Solver(
    GoalObjects=flatten([edgelengths, show, anchor, anchor_2, vertexloads]),
    Reset=Button(),
    Threshold=1e-15,
    Tolerance=0.01,
    On=Toggle(True))  # -> I, V, O
list_item = ListItem(List=solver.O, Index=0, Wrap=True)
weaverbird_s_catmull_clark_subdivision_2 = WeaverbirdsCatmullClarkSubdivision(MeshCurves=list_item, Level=Slider(0.5, range=0..1), SmoothNakedEdges=1)

# ---- group: RH_OUT:mesh
mesh = Mesh(weaverbird_s_catmull_clark_subdivision_2)

# ----
mesh_edges = MeshEdges(Mesh=mesh)  # -> NakedEdges, InteriorEdges, NonManifoldEdges

# ---- group: RH_OUT:edges
curve_5 = Curve([mesh_edges.InteriorEdges, mesh_edges.NakedEdges])
